# Requirement set Requirement_V_5 (R2022b)

## 1 [Requirement_V_5] References to Requirement_V_5.docx (Container)
Read-only references to Microsoft Word document.

### 1.1 [F1 Detect]

### 1.2 [F1.1 When <input ‘System Ready’] F1.1 When <input ‘System Ready’ ...
F1.1 When <input ‘System Ready’ is received >the function <F1.1> shall generate <output ‘SystemCalibrated’ >.

### 1.3 [F1.2 When <input ‘SystemCalibrat] F1.2 When <input ‘SystemCalibrat...
F1.2 When <input ‘SystemCalibrated’ is received, input ‘LookForProduct’ is received

### 1.4 [AND input ‘Reset Signal’ is rece] AND input ‘Reset Signal’ is rece...
AND input ‘Reset Signal’ is received the function <F1.2> shall generate <output ‘InterpretSignal’ >.

### 1.5 [F1.3 When <input ‘InterpretSigna] F1.3 When <input ‘InterpretSigna...
F1.3 When <input ‘InterpretSignal’ is received AND input ‘Product’ is received>the function <F1.3> shall generate <output ‘Product Detected’ AND ’Count’>.

### 1.6 [F2 Inspect]

### 1.7 [F2.1 When <input: ‘Product’>, Th] F2.1 When <input: ‘Product’>, Th...
F2.1 When <input: ‘Product’>, The function<F2.1>Shall generate <output: ‘OutBus’>

### 1.8 [F2.2 When <input: ‘Detection sig] F2.2 When <input: ‘Detection sig...
F2.2 When <input: ‘Detection signal’>, The function<F2.2>Shall generate <output: ‘Trigger’>

### 1.9 [F2.3 When <input: ‘Product AND P] F2.3 When <input: ‘Product AND P...
F2.3 When <input: ‘Product AND Power AND Trigger’>, The function<F2.3>Shall generate <output: ‘Product Image AND OutBus AND OutBus1’>

### 1.10 [F2.4 When <input: ‘Product Image] F2.4 When <input: ‘Product Image...
F2.4 When <input: ‘Product Image’>, The function<F2.4>Shall generate <output: ‘ProductOrientation’>

### 1.11 [F2.5 When <input: ‘Product Image] F2.5 When <input: ‘Product Image...
F2.5 When <input: ‘Product Image’>, The function<F2.5>Shall generate <output: ‘ExtractedQRCode’>

### 1.12 [F2.6 When <input: ‘ExtractedQRCo] F2.6 When <input: ‘ExtractedQRCo...
F2.6 When <input: ‘ExtractedQRCode’>, The function<F2.6>Shall generate <output: ‘ExportQR’>

### 1.13 [F2.7 When <input: ‘Product Image] F2.7 When <input: ‘Product Image...
F2.7 When <input: ‘Product Image’>, The function<F2.7>Shall generate <output: ‘Dimension of product’>

### 1.14 [F2.7.1 When <input: ‘Product Ima] F2.7.1 When <input: ‘Product Ima...
F2.7.1 When <input: ‘Product Image’>, The function<F2.7.1>Shall generate <output: ‘Coordinates’>

### 1.15 [F2.7.2 When <input: ‘Coordinates] F2.7.2 When <input: ‘Coordinates...
F2.7.2 When <input: ‘Coordinates’>, The function<F2.7.2>Shall generate <output: ‘Dimension of product’>

### 1.16 [F2.8 When <input: ‘Product Image] F2.8 When <input: ‘Product Image...
F2.8 When <input: ‘Product Image’>, The function<F2.7>Shall generate <output: ‘ProductPosition’>

### 1.17 [F3 Compare Dimensions]

### 1.18 [F3.1 When <input ‘Dimension of p] F3.1 When <input ‘Dimension of p...
F3.1 When <input ‘Dimension of product’ is received >the function <F3.1> shall generate <output ‘ImportedDimensions’ >.

### 1.19 [F3.2 When <input ‘ImportedDimens] F3.2 When <input ‘ImportedDimens...
F3.2 When <input ‘ImportedDimensions’ is received >the function <F3.2> shall generate <output ‘ReferDBDimensions’ AND ‘CurrentDimensions’>.

### 1.20 [F3.3 When <input ‘ReferDBDimensi] F3.3 When <input ‘ReferDBDimensi...
F3.3 When <input ‘ReferDBDimensions’ is received >the function <F3.3> shall generate <output ‘DBDimensions’ >.

### 1.21 [F3.4 When <input ‘DBDimensions’] F3.4 When <input ‘DBDimensions’ ...
F3.4 When <input ‘DBDimensions’ is received >the function <F3.4> shall generate <output ‘ExpectedDimensions’ >.

### 1.22 [F3.5 When <input ‘ExpectedDimens] F3.5 When <input ‘ExpectedDimens...
F3.5 When <input ‘ExpectedDimensions’ is received AND input ‘CurrentDimensions’ is received >the function <F3.5> shall generate <output ‘Faulty Product Detected’ AND ‘BeginPickOperation’>.

### 1.23 [F4 Calibrate]

### 1.24 [F4.1 When <input: ‘Power AND Mot] F4.1 When <input: ‘Power AND Mot...
F4.1 When <input: ‘Power AND Motor AND Frame components’>, The function<F4.1>Shall generate <output: ‘ConfirmSetup’>.

### 1.25 [F4.1.1 When <input: ‘Frame compo] F4.1.1 When <input: ‘Frame compo...
F4.1.1 When <input: ‘Frame components’>, The function<F4.1.1>Shall generate <output: ‘Frame’>.

### 1.26 [F4.1.2 When <input: ‘Motor AND F] F4.1.2 When <input: ‘Motor AND F...
F4.1.2 When <input: ‘Motor AND Frame’>, The function<F4.1.2>Shall generate <output: ‘Frame and motor setup’>.

### 1.27 [F4.1.3 When <input: ‘Frame and m] F4.1.3 When <input: ‘Frame and m...
F4.1.3 When <input: ‘Frame and motor setup AND Power’>, The function<F4.1.3>Shall generate <output: ‘Physical setup -> ConfirmSetup’>.

### 1.28 [F4.2 When <input: ‘UIReady’>, Th] F4.2 When <input: ‘UIReady’>, Th...
F4.2 When <input: ‘UIReady’>, The function<F4.2>Shall generate <output: ‘Trigger’>.

### 1.29 [F4.3 When <input: ‘Trigger AND S] F4.3 When <input: ‘Trigger AND S...
F4.3 When <input: ‘Trigger AND SetupConfirmation AND Power’>, The function<F4.3>Shall generate <output: ‘JogComplete’>.

### 1.30 [F4.4 When <input: ‘JogComplete A] F4.4 When <input: ‘JogComplete A...
F4.4 When <input: ‘JogComplete AND Power’>, The function<F4.4>Shall generate <output: ‘Robot at home position -> ConfirmCalibration’>.

### 1.31 [F5 Pick Product]

### 1.32 [F Begin Task When <input: ‘Beigi] F Begin Task When <input: ‘Beigi...
F Begin Task When <input: ‘Beiginpickoperation’>, The function<F Begin Task>Shall generate <output: ‘Coordintes AND Orientation’>.

### 1.33 [F5.1 When <input: ‘Coordinates’>] F5.1 When <input: ‘Coordinates’>...
F5.1 When <input: ‘Coordinates’>, The function<F5.1>Shall generate <output: ‘Importedcoordiantes’>.

### 1.34 [F5.2 When <input: ‘Orientation’>] F5.2 When <input: ‘Orientation’>...
F5.2 When <input: ‘Orientation’>, The function<F5.2>Shall generate <output: ‘Importedorientation’>.

### 1.35 [F5.3 When <input: ‘Importedorien] F5.3 When <input: ‘Importedorien...
F5.3 When <input: ‘Importedorientation AND Importedcoordinates AND New coordinates ’>, The function<F5.3>Shall generate <output: ‘Current Position AND Defined Path’>.

### 1.36 [F5.4 When <input: ‘Corrected Pos] F5.4 When <input: ‘Corrected Pos...
F5.4 When <input: ‘Corrected Postition AND Corrected Force’>, The function<F5.4>Shall generate <output: ‘New coordinates AND New Force value’>.

### 1.37 [F5.5 When <input: ‘Defined Path’] F5.5 When <input: ‘Defined Path’...
F5.5 When <input: ‘Defined Path’>, The function<F5.5>Shall generate <output: ‘Ready to pick Pick Product’>.

### 1.38 [F5.6 When <input: ‘New Force val] F5.6 When <input: ‘New Force val...
F5.6 When <input: ‘New Force value AND Ready to pick Pick Product ’>, The function<F5.6>Shall generate <output: ‘Product Picked AND Current Force’>

### 1.39 [F6 Translate Product]

### 1.40 [F6.1 When <input ‘Product Picked] F6.1 When <input ‘Product Picked...
F6.1 When <input ‘Product Picked’ is received >the function <F6.1> shall generate <output ‘Ready to be Placed’ >.

### 1.41 [F7 Place Product]

### 1.42 [F7.1 When <input ‘Corrected Posi] F7.1 When <input ‘Corrected Posi...
F7.1 When <input ‘Corrected Position’ is received >the function <F7.1> shall generate <output ‘New Position’ >.

### 1.43 [F7.2 When <input ‘Ready to be pl] F7.2 When <input ‘Ready to be pl...
F7.2 When <input ‘Ready to be placed’ is received AND input ‘New Position’ is received>the function <F1.3> shall generate <output ‘Gripper Lowered’ >.

### 1.44 [F7.3 When <input ‘Gripper Lowere] F7.3 When <input ‘Gripper Lowere...
F7.3 When <input ‘Gripper Lowered’ is received >the function <F7.3> shall generate <output ‘Product Released’ >.

### 1.45 [F7.4 When <input ‘Product Releas] F7.4 When <input ‘Product Releas...
F7.4 When <input ‘Product Released’ is received >the function <F7.4> shall generate <output ‘Product Placed’ >.

### 1.46 [F08 Handle Contingencies]

### 1.47 [F8.1 When <input ‘Force on gripp] F8.1 When <input ‘Force on gripp...
F8.1 When <input ‘Force on gripper’ is received >the function <F8.1> shall generate <output ‘Appropriate force’ >.

### 1.48 [F9 Hold Operations]

### 1.49 [F9.1 When <input ‘Product Not De] F9.1 When <input ‘Product Not De...
F9.1 When <input ‘Product Not Detected’ is received >the function <F9.1> shall generate <output ‘Return To Detection’ >.

### 1.50 [F10 Halt Operations]

### 1.51 [F10.1 When <input ‘EmergencyStop] F10.1 When <input ‘EmergencyStop...
F10.1 When <input ‘EmergencyStopSignal’ is received >the function <F10.1> shall generate <output ‘RecievedInput’ >.

### 1.52 [F10.2 When <input ‘RecievedInput] F10.2 When <input ‘RecievedInput...
F10.2 When <input ‘RecievedInput’ is received >the function <F10.2> shall generate <output ‘StopOperation’ >.

### 1.53 [F10.3 When <input ‘StopOperation] F10.3 When <input ‘StopOperation...
F10.3 When <input ‘StopOperation’ is received >the function <F10.3> shall generate <output ‘Stop Signal’ AND ‘NotifyOperator’>.

### 1.54 [F10.3 When <input ‘NotifyOperato] F10.3 When <input ‘NotifyOperato...
F10.3 When <input ‘NotifyOperator’ is received >the function <F10.4> shall generate <output ‘NotifySTOP’ >.

### 1.55 [F11.Handle User Interface]

### 1.56 [F1.1 When <input ‘Reset Confirma] F1.1 When <input ‘Reset Confirma...
F1.1 When <input ‘Reset Confirmation’ is received >the function <F1.1> shall generate <output ‘Logout Successful’ >.

### 1.57 [F11.2 When <input ‘Power Supply’] F11.2 When <input ‘Power Supply’...
F11.2 When <input ‘Power Supply’ is received >the function <F11.2> shall generate <output ‘WaitforInput’ >.

### 1.58 [F13.3 When <input ‘Receive User] F13.3 When <input ‘Receive User ...
F13.3 When <input ‘Receive User Input’ is received >the function <F11.3> shall generate <output ‘Ready to Interact’ >.

### 1.59 [F11.4 When <input ‘Provide User] F11.4 When <input ‘Provide User ...
F11.4 When <input ‘Provide User Interface’ is received >the function <F11.4> shall generate <output ‘VisualsReady’ >.

### 1.60 [F11.5 When <input ‘VisualsReady’] F11.5 When <input ‘VisualsReady’...
F11.5 When <input ‘VisualsReady’ and ‘User Credentials’ is received >the function <F11.5> shall generate <output ‘Received Credentials’ >.

### 1.61 [F11.6 When <input ‘Received Cred] F11.6 When <input ‘Received Cred...
F11.6 When <input ‘Received Credentials’ is received >the function <F11.6> shall generate <output ‘Confirmation’ >.

### 1.62 [F11.7 When <input ‘Confirmation’] F11.7 When <input ‘Confirmation’...
F11.7 When <input ‘Confirmation’ is received >the function <F11.7> shall generate <output ‘Login Confirm’ and ‘Open Dashboard’ >.

### 1.63 [F11.8 When <input ‘Open Dashboar] F11.8 When <input ‘Open Dashboar...
F11.8 When <input ‘Open Dashboard’ is received >the function <F11.8> shall generate <output ‘Dashboard Loaded’ >.

### 1.64 [F11.9 When <input ‘Stop Button’] F11.9 When <input ‘Stop Button’ ...
F11.9 When <input ‘Stop Button’ is received >the function <F11.9> shall generate <output ‘Notify Emergency’ >.

### 1.65 [F11.10 When <input ‘Dashboard Lo] F11.10 When <input ‘Dashboard Lo...
F11.10 When <input ‘Dashboard Loaded’ and ‘Faulty Product Detected’ and ‘Count’ and ‘Observe parameter’ is received > the function <F11.10> shall generate <output ‘Notify Emergency’ >.

### 1.66 [F11.11 When <input ‘Notify Emerg] F11.11 When <input ‘Notify Emerg...
F11.11 When <input ‘Notify Emergency’ is received >the function <F11.11> shall generate <output ‘’ >.

### 1.67 [F11.12 When <input ‘Logout Confi] F11.12 When <input ‘Logout Confi...
F11.12 When <input ‘Logout Confirmed’ and ‘Stop Confirm’ is received >the function <F11.12> shall generate <output ‘Reset system’ >.

### 1.68 [F11.13 When <input ‘DB Updated’] F11.13 When <input ‘DB Updated’ ...
F11.13 When <input ‘DB Updated’ is received >the function <F11.13> shall generate <output ‘Stop Operation’ >.

### 1.69 [F12 Reset Position]

### 1.70 [F12.1 When <input ‘Product place] F12.1 When <input ‘Product place...
F12.1 When <input ‘Product placed’ is received OR ‘Log-out’ is received >the function <F12.1> shall generate <output ‘home position’ >.

### 1.71 [F12.2 When <input ‘home position] F12.2 When <input ‘home position...
F12.2 When <input ‘home position’ is received >the function <F12.2> shall generate <output ‘power off signal’ AND ‘Coordinates’ >.

### 1.72 [F12.3 When <input ‘power off sig] F12.3 When <input ‘power off sig...
F12.3 When <input ‘power off signal’ is received >the function <F12.3> shall generate <output ‘System ready’ >.

### 1.73 [F12.4 When <input ‘Coordinates’] F12.4 When <input ‘Coordinates’ ...
F12.4 When <input ‘Coordinates’ is received >the function <F12.4> shall generate <output ‘HoldAtHomePosition’ >.

## 2 [Requirement_V_5_1] References to Requirement_V_5_1.docx (Container)
Imported from Microsoft Word

### 2.1 [F11.14 When <input ‘Logout Promp...]
F11.14 When <input ‘Logout Prompt’ is received >the function <F11.14> shall generate <output ‘Logout Confirm’ and ‘DB Updated’ >.

### 2.2 [F11.15 When <input ‘Show Paramet...]
F11.15 When <input ‘Show Parameters’ is received >the function <F11.15> shall generate <output ‘system state’ and ‘Logout Prompt’ and ‘Observe Parameters’>.